# Grasshopper definition NoiseFieldSim.gh (Grasshopper 1.0.8)
# plug-ins: Noise

sqgrid = Square(Plane=PlaneXY(0, 0, 0), Size=".5", ExtentX="40", ExtentY="40")  # -> Cells, Points
pn = PerlinNoise(
    Points=sqgrid.Points,
    Seed="1",
    Amplitude=1,
    SmoothStep=0,
    FrequecyX=1,
    FrequecyY="2",
    FrequecyZ=1,
    Jitter=0,
    AlignVector=Vector(1, 0, 0))
panel = Panel(pn)
sn = SimplexNoise(Points=sqgrid.Points, Size="6", Seed=0, T=Slider(4.294, range=0..10))
sn_2 = SimplexNoise(Points=sqgrid.Points, Size="1", Seed=0, T=Slider(1.649, range=0..10))
panel_2 = Panel(sn)
panel_3 = Panel(sn_2)
graph = GraphMapper(panel_2, x0=0, x1=1, y0=0, y1=1, container_name="Bezier", cpx=[0, 1, 0.3641308844, 1], cpy=[0, 0, 0.9983695745, 1])
graph_2 = GraphMapper(
    panel_3,
    x0=0,
    x1=1,
    y0=0,
    y1=1,
    container_name="Bezier",
    cpx=[0, 0.7858674526, 0.4257436693, 1],
    cpy=[0, 0.002551078796, 1, 1])
multiplication = Multiplication(A=Slider(0.114, range=0..1), B=graph_2)
addition = Addition(A=graph, B=multiplication)
Z = UnitZ(Factor=addition)
multiplication_2 = Multiplication(A=Z, B=Slider(7, range=0..100))
move = Move(Geometry=sqgrid.Points, Motion=multiplication_2)  # -> Geometry, Transform
srfgrid = SurfaceFromPoints(Points=flatten(move.Geometry), UCount="41", Interpolate=False)
