# Grasshopper definition 1 Import Flickr.gh (Grasshopper 1.0.8)
# plug-ins: Heron, eleFront

# ----
# READ FILE
path = FilePath("C:\Users\VincentNowak\Dropbox\UCL RC15 Skill Resources\RC15-Resources\tutorials\mapping-and-spatial-analysis\flickr-mapping\london_photos2.csv")
file = ReadFile(File=path, PerLineParse=True)
# SET ANCHOR POINT
panel = Panel("0")
cull_i = CullIndex(List=file, Indices=panel, Wrap=True)
sub_list = SubList(List=cull_i, Domain="1 To 500", Wrap=Toggle(False))  # -> List, Index
tab = Panel("\t")
split = TextSplit(Text=sub_list.List, Separators=tab)  # -> simplify(Result)

# ----
# get ID
panel_2 = Panel("1")
item = ListItem(List=split, Index=panel_2, Wrap=True)  # -> simplify(flatten(Item))
tstat = TreeStatistics(Tree=item)  # -> Paths, Length, Count
count_id = Panel(tstat.Length)

# ----
# CONVERT COORDINATES
panel_3 = Panel("9")
item_2 = ListItem(List=split, Index=panel_3, Wrap=True)  # -> simplify(Item), simplify(Item1)
flatten = FlattenTree(Tree=item_2.Item, Path="{0}")
flatten_2 = FlattenTree(Tree=item_2.Item1, Path="{0}")
ddtoxy = DecimalDegreesToXY(Latitude=flatten, Longitude=flatten_2)  # -> XyPoint, Transform
tstat_2 = TreeStatistics(Tree=ddtoxy.XyPoint)  # -> Paths, Length, Count
panel_4 = Panel(ddtoxy.XyPoint)
geo = Geometry(ddtoxy.XyPoint)
count_points = Panel(tstat_2.Length)

# ----
# get URL
panel_5 = Panel("11")
item_3 = ListItem(List=split, Index=panel_5, Wrap=True)  # -> simplify(flatten(Item))
tstat_3 = TreeStatistics(Tree=item_3)  # -> Paths, Length, Count
count_id_2 = Panel(tstat_3.Length)

# ----
# get Year
panel_6 = Panel("8")
item_4 = ListItem(List=split, Index=panel_6, Wrap=True)  # -> simplify(flatten(Item))
tstat_4 = TreeStatistics(Tree=item_4)  # -> Paths, Length, Count
panel_7 = Panel(item_4)
count_id_3 = Panel(tstat_4.Length)
text_split = TextSplit(Text=panel_7, Separators=" ")
list_item = ListItem(List=text_split, Index="0", Wrap=True)
text_split_2 = TextSplit(Text=list_item, Separators="-")
list_item_2 = ListItem(List=text_split_2, Index="0", Wrap=True)  # -> flatten(Item), flatten(Item1), flatten(Item2)
tstat_5 = TreeStatistics(Tree=list_item_2.Item2)  # -> Paths, Length, Count
year = Panel(list_item_2.Item)
month = Panel(list_item_2.Item1)
day = Panel(list_item_2.Item2)
length_of_tree = Panel(tstat_5.Length)

# ----
# Keys
# Values
year_2 = Text(graft(year))
# Bake with attributes
id = Text(graft(item))
url = Text(graft(item_3))
tstat_6 = TreeStatistics(Tree=url)  # -> Paths, Length, Count
tstat_7 = TreeStatistics(Tree=year_2)  # -> Paths, Length, Count
tstat_8 = TreeStatistics(Tree=id)  # -> Paths, Length, Count
dup = DuplicateData(Data="URL", Number=tstat_6.Length, Order=True)  # -> simplify(Data)
dup_2 = DuplicateData(Data="Year", Number=tstat_7.Length, Order=True)  # -> simplify(Data)
dup_3 = DuplicateData(Data="ID", Number=tstat_8.Length, Order=True)  # -> simplify(Data)
panel_8 = Panel("""0
1
2""")
weave = Weave(Pattern=panel_8, Stream0=simplify(id), Stream1=simplify(url), Stream2=simplify(year_2), NullGaps=False)
weave_2 = Weave(Pattern=panel_8, Stream0=dup_3, Stream1=dup, Stream2=dup_2, NullGaps=False)
panel_9 = Panel(weave_2)
panel_10 = Panel(weave)
ef_att = EleFrontAttributes(Keys=panel_9, Values=panel_10, Layer="Points", maintainBakeName=False)  # -> Attributes, Keys, Values, Name, Layer, ColourSource, DisplayColour, MaterialSource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
points = Geometry(simplify(graft(geo)))
bake = BakeObjects(Geometry=points, Attributes=ef_att.Attributes, Bake=False, createGroups=False)  # -> Message, Ghosts

# ----
# The earth anchor point has to be set in any case.
# The 0,0,0 point of Rhino has to be set to a real world coordinate.
# You can get the point by searching for it. Or you simply look up a place in google maps, copy/paste the cooridantes and plug them into the "SetEAP" component.
lat = Panel("51.512297")
long = Panel("-0.121123")
seteap = SetEarthAnchorPoint(SetEAP=Toggle(True), Latitude=lat, Longitude=long)

panel_11 = Panel(split)
panel_12 = Panel(text_split_2)
