# Grasshopper definition Module B2.gh (Grasshopper 1.0.8)
# plug-ins: PedSimulation, VVVVLink

# ----
# Gate (start - destination)
panel = Panel("gate1")
point = Point(<point referenced from the Rhino model>)
point_2 = Point(<point referenced from the Rhino model>)
point_3 = Point(<point referenced from the Rhino model>)
point_4 = Point(<point referenced from the Rhino model>)
gate = Gate(Position=point_3, GateName=panel, ExitTime=1, AccessRadius=Slider(2.1141, range=0..10), DrawDot=Toggle(False))
gate_2 = Gate(Position=point_4, GateName="gate4", ExitTime=1, AccessRadius=Slider(2.4933, range=0..10), DrawDot=Toggle(False))
gate_3 = Gate(Position=point, GateName="gate2", ExitTime=1, AccessRadius=Slider(2.5622, range=0..10), DrawDot=Toggle(False))
gate_4 = Gate(Position=point_2, GateName="gate3", ExitTime=1, AccessRadius=Slider(2.3853, range=0..10), DrawDot=Toggle(False))

# ----
# Interests
panel_2 = Panel("food")
program = Program(ProgramName="leisure", DisplayColor=ColourSwatch(SwatchColor=RGB(255, 255, 255)))
program_2 = Program(ProgramName=panel_2, DisplayColor=ColourSwatch(SwatchColor=RGB(255, 255, 255)))
program_3 = Program(ProgramName="perform", DisplayColor=ColourSwatch(SwatchColor=RGB(255, 255, 255)))
program_4 = Program(ProgramName="square", DisplayColor=ColourSwatch(SwatchColor=RGB(255, 255, 255)))
point_5 = Point([<point referenced from the Rhino model> x5])
point_6 = Point([<point referenced from the Rhino model> x4])
point_7 = Point([<point referenced from the Rhino model> x3])
point_8 = Point([<point referenced from the Rhino model> x2])
target = Target(
    Position=point_5,
    Program=program_2,
    VisitingTime=Slider(39.75, range=0..100),
    AccessRadius=1,
    DrawDot=Toggle(True),
    createMultipleTargets=True)
target_2 = Target(
    Position=point_6,
    Program=program,
    VisitingTime=Slider(55.44, range=0..100),
    AccessRadius=1,
    DrawDot=Toggle(True),
    createMultipleTargets=True)
target_3 = Target(
    Position=point_7,
    Program=program_4,
    VisitingTime=Slider(20.14, range=0..100),
    AccessRadius=1,
    DrawDot=Toggle(True),
    createMultipleTargets=True)
target_4 = Target(
    Position=point_8,
    Program=program_3,
    VisitingTime=Slider(16.22, range=0..100),
    AccessRadius=1,
    DrawDot=Toggle(True),
    createMultipleTargets=True)

merge = Merge(Data1=gate, Data2=gate_3, Data3=gate_4, Data4=gate_2)
merge_2 = Merge(Data1=program_2, Data2=program, Data3=program_4, Data4=program_3)
fanshapedvision = FanShapedVision(Angle=149.994, Distance=50)
cross_reference = CrossReference(ListListA=merge, ListListB=merge, CrossMode=1)  # -> ListListA, ListListB
persontemplate = PersonTemplate(
    StartGate=cross_reference.ListListA,
    DestinationGate=cross_reference.ListListB,
    Interests=merge_2,
    NeedValue=1,
    StartNumber=0,
    Probability=Slider(0.541, range=0..1),
    TimeLimit=-1,
    Vision=fanshapedvision,
    BodyRadius=Slider(3, range=0..10),
    TargetForce=Slider(191.96, range=0..1000),
    DisplayColor=ColourSwatch(SwatchColor=RGB(255, 223, 255)),
    PersonTemplateDirectionMode=1)
merge_3 = Merge(Data1=target, Data2=target_2, Data3=target_3, Data4=target_4)
curve = Curve([<curve referenced from the Rhino model> x14])
trigger = Trigger(Interval=20, TimerInterval=20, Target=pedsimulationsystem)
pedsimulationsystem = PedSimulationSystem(
    Reset=Button(),
    PersonTemplates=persontemplate,
    ObstacleCurves=curve,
    Population=Slider(9, range=0..10),
    Targets=merge_3,
    GenerationTime=1)  # -> Out, People, GraphEdges, GraphVertices
# Lighting Control
drawperson = DrawPerson(People=pedsimulationsystem.People, drawCurrentTargetFill=False, drawFOV=False, drawNumber=False)

deconstructperson = DeconstructPerson(Person=pedsimulationsystem.People)  # -> Position, BodyRadius, Velocity, Acceleration, CurrentPath, Behaviors, Forces, MovementState, Interests
circle_cnr = CircleCNR(Center=deconstructperson.Position, Normal=Vector(0, 0, 1), Radius=Slider(5.5, range=0..10))
circle_cnr_2 = CircleCNR(Center=deconstructperson.Position, Normal=Vector(0, 0, 1), Radius=Slider(2.5, range=0..10))
circle_cnr_3 = CircleCNR(Center=deconstructperson.Position, Normal=Vector(0, 0, 1), Radius=Slider(1, range=0..1))
boundary_surfaces = BoundarySurfaces(Edges=circle_cnr_3)
boundary_surfaces_2 = BoundarySurfaces(Edges=circle_cnr_2)
proximity_2d = Proximity2D(
    Points=deconstructperson.Position,
    Plane=PlaneXY(0, 0, 0),
    Group=5,
    MinRadius=Slider(1, range=0..10),
    MaxRadius=Slider(9, range=0..10))  # -> Links, Topology
custom_preview = CustomPreview(Geometry=boundary_surfaces, Material=ColourSwatch(SwatchColor=RGB(255, 255, 255)))
custom_preview_2 = CustomPreview(Geometry=circle_cnr, Material=ColourSwatch(SwatchColor=RGB(175, 189, 174)))
tree_statistics = TreeStatistics(Tree=proximity_2d.Topology)  # -> Paths, Length, Count
larger_than = LargerThan(FirstNumber=tree_statistics.Length, SecondNumber=Slider(0, range=0..100))  # -> LargerThan, OrEqualTo
dispatch = Dispatch(List=boundary_surfaces_2, DispatchPattern=larger_than.LargerThan)  # -> ListA, ListB
custom_preview_3 = CustomPreview(Geometry=dispatch.ListB, Material=ColourSwatch(SwatchColor=RGB(188, 186, 153)))
custom_preview_4 = CustomPreview(Geometry=dispatch.ListA, Material=ColourSwatch(SwatchColor=RGB(255, 0, 255)))

panel_3 = Panel(circle_cnr)
pt = Point(deconstructperson.Position)
smooth = SettingsQuality()
vlinks = VLinkSend(Geometry=flatten(pt), MeshSettings=smooth, CurveTolerance="0.01", Send=Toggle(True))
