# Grasshopper definition Module C-1.gh (Grasshopper 1.0.8)
# plug-ins: PedSimulation, VVVVLink

# ----
# Gate (start - destination)
panel = Panel("start")
point = Point(<point referenced from the Rhino model>)
point_2 = Point(<point referenced from the Rhino model>)
gate = Gate(Position=point, GateName="destination", ExitTime=1, AccessRadius=Slider(1.582, range=0..10), DrawDot=Toggle(True))
gate_2 = Gate(Position=point_2, GateName=panel, ExitTime=1, AccessRadius=Slider(1.3326, range=0..10), DrawDot=Toggle(True))

# ----
# Interests
panel_2 = Panel("food")
program = Program(ProgramName="leisure", DisplayColor=ColourSwatch(SwatchColor=RGB(146, 192, 104)))
program_2 = Program(ProgramName=panel_2, DisplayColor=ColourSwatch(SwatchColor=RGB(255, 255, 255)))
program_3 = Program(ProgramName="perform", DisplayColor=ColourSwatch(SwatchColor=RGB(106, 115, 255)))
program_4 = Program(ProgramName="square", DisplayColor=ColourSwatch(SwatchColor=RGB(236, 59, 255)))
point_3 = Point([<point referenced from the Rhino model> x3])
point_4 = Point([<point referenced from the Rhino model> x3])
point_5 = Point([<point referenced from the Rhino model> x3])
point_6 = Point([<point referenced from the Rhino model> x3])
target = Target(
    Position=point_3,
    Program=program_2,
    VisitingTime=Slider(10.17, range=0..100),
    AccessRadius=Slider(91.21, range=0..100),
    DrawDot=Toggle(False),
    createMultipleTargets=True)
target_2 = Target(
    Position=point_4,
    Program=program,
    VisitingTime=Slider(24.7, range=0..100),
    AccessRadius=Slider(91.21, range=0..100),
    DrawDot=Toggle(False),
    createMultipleTargets=True)
target_3 = Target(
    Position=point_5,
    Program=program_4,
    VisitingTime=Slider(9.07, range=0..100),
    AccessRadius=Slider(91.21, range=0..100),
    DrawDot=Toggle(False),
    createMultipleTargets=True)
target_4 = Target(
    Position=point_6,
    Program=program_3,
    VisitingTime=Slider(16.22, range=0..100),
    AccessRadius=Slider(91.21, range=0..100),
    DrawDot=Toggle(False),
    createMultipleTargets=True)

merge = Merge(Data1=gate_2, Data2=gate)
cross_reference = CrossReference(ListListA=merge, ListListB=merge, CrossMode=1)  # -> ListListA, ListListB
merge_2 = Merge(Data1=program_2, Data2=program, Data3=program_4, Data4=program_3)
fanshapedvision = FanShapedVision(Angle=149.994, Distance=50)
persontemplate = PersonTemplate(
    StartGate=cross_reference.ListListA,
    DestinationGate=cross_reference.ListListB,
    Interests=merge_2,
    NeedValue=1,
    StartNumber=0,
    Probability=Slider(0.975, range=0..1),
    TimeLimit=-1,
    Vision=fanshapedvision,
    BodyRadius=Slider(2, range=0..10),
    TargetForce=Slider(199.26, range=0..1000),
    DisplayColor=ColourSwatch(SwatchColor=RGB(255, 223, 255)),
    PersonTemplateDirectionMode=1)
merge_3 = Merge(Data1=target, Data2=target_2, Data3=target_3, Data4=target_4)
curve = Curve([<curve referenced from the Rhino model> x14])
trigger = Trigger(Interval=10, TimerInterval=10, Target=pedsimulationsystem)
pedsimulationsystem = PedSimulationSystem(
    Reset=Button(),
    PersonTemplates=persontemplate,
    ObstacleCurves=curve,
    Population=Slider(1, range=0..10),
    Targets=merge_3,
    GenerationTime=1)  # -> Out, People, GraphEdges, GraphVertices
drawperson = DrawPerson(People=pedsimulationsystem.People, drawCurrentTargetFill=False, drawFOV=False, drawNumber=False)

# ----
# colour changing
deconstructperson = DeconstructPerson(Person=pedsimulationsystem.People)  # -> Position, BodyRadius, Velocity, Acceleration, CurrentPath, Behaviors, Forces, MovementState, Interests
curve_2 = Curve([<curve referenced from the Rhino model> x839])
boundary_surfaces = BoundarySurfaces(Edges=curve_2)
area = Area(Geometry=boundary_surfaces)  # -> Area, Centroid
closest_point = ClosestPoint(Point=deconstructperson.Position, Cloud=area.Centroid)  # -> ClosestPoint, CPIndex, Distance
data_recorder = DataRecorder(closest_point.CPIndex, DataLimit=-10, RecordData=True)
list_item = ListItem(List=boundary_surfaces, Index=closest_point.CPIndex, Wrap=True)
custom_preview = CustomPreview(Geometry=boundary_surfaces, Material=ColourSwatch(SwatchColor=RGBA(226, 197, 44, 2)))
create_set = CreateSet(List=data_recorder)  # -> Set, Map
custom_preview_2 = CustomPreview(Geometry=list_item, Material=ColourSwatch(SwatchColor=RGB(188, 0, 42)))
list_item_2 = ListItem(List=boundary_surfaces, Index=create_set.Set, Wrap=True)
custom_preview_3 = CustomPreview(Geometry=list_item_2, Material=ColourSwatch(SwatchColor=RGBA(136, 72, 255, 174)))

panel_3 = Panel(deconstructperson.Position)
smooth = SettingsQuality()
jagged = SettingsSpeed()
vlinks = VLinkSend(Geometry=list_item, MeshSettings=jagged, CurveTolerance=0.5, Strings=panel_3, Send=Toggle(True))

number_slider = Slider(18, range=0..100)
number_slider_2 = Slider(28.266, range=0..100)
number_slider_3 = Slider(10, range=0..10)
point_7 = Point(<point referenced from the Rhino model>)
number_slider_4 = Slider(1, range=0..1)
square = Square(Plane=point_7, Size=number_slider_3, ExtentX=number_slider_2, ExtentY=number_slider)  # -> Cells, Points
mesh_plane = MeshPlane(Boundary=square.Cells, WidthCount=number_slider_4, HeightCount=number_slider_4)  # -> flatten(Mesh), Area
unit_z = UnitZ(Factor=expr("-x", Slider(3, range=0..10)))
gridpersoncounter = GridPersonCounter(
    Reset=Button(),
    BasePt=point_7,
    CellSize=number_slider_3,
    ExtentX=number_slider_2,
    ExtentY=number_slider,
    GridPersonCounterMode=3)  # -> Count, MaxCount
move = Move(Motion=unit_z)  # -> Geometry, Transform
division = Division(A=gridpersoncounter.Count, B=gridpersoncounter.MaxCount)
plane = Plane()
gradient = Gradient(LowerLimit="1", UpperLimit="0", Parameter=division, stops=[0.488: RGB(147, 112, 219)])
custom_preview_4 = CustomPreview(Geometry=plane, Material=ColourSwatch(SwatchColor=RGB(255, 255, 255)))
custom_preview_5 = CustomPreview(Geometry=mesh_plane.Mesh, Material=gradient)
