# Grasshopper definition SVG Export from rhino.gh (Grasshopper 1.0.8)

panel = Panel("C:\Users\VincentNowak\Dropbox\UCL RC15 Skill Resources\RC15-Resources\tutorials\mapping-and-spatial-analysis\heatmaps\assets\FourQuarter.svg")

# ---- group: Draw Inside
rectangle = Rectangle(Plane=PlaneXY(0, 0, 0), XSize="-50 To 50", YSize="-50 To 50", Radius=0)  # -> Rectangle, Length

# ----
# **QGIS SVG Exporter — Rhino 8 / Grasshopper Python 3**
# 
# This Python component exports closed planar curves from Rhino as a clean SVG symbol for QGIS.
# 
# The SVG uses a fixed **100 × 100 canvas**, corresponding to a drawing area from −50 to +50 in both X and Y, centred on the Rhino origin.
# 
# Geometry is exported at its original position and relative size, without automatic scaling or centring. One Rhino unit corresponds to one SVG unit.
# 
# Multiple closed curves form a single filled shape. Nested curves create transparent openings, similar to holes in a hatch.
# 
# The SVG supports fill and outline colours controlled directly in QGIS. Its final display size is determined by the QGIS symbol settings.
# 
# **Inputs:** Closed curves (flattened), output file path and export button. The 100 × 100 construction frame should not be included in the exported curves.
button = Button()
crv = Curve([<curve referenced from the Rhino model> x4])
py3 = Python3Script(C=crv, Path=panel, Run=button)  # -> out, SVG, Status; inputs C: list of Curve, Path: String
# ---------- py3: Python ----------
import Rhino.Geometry as rg
import os
import math

# Rhino 8 / Grasshopper Python 3
#
# Fixed SVG canvas: 100 x 100
# Rhino X/Y range: -50 to +50
# No scaling or automatic centring
#
# Closed curves: filled shapes
# Nested closed curves: transparent holes
# Open curves: strokes only
#
# Inputs: C, Path, Run
# Outputs: SVG, Status

SVG = ""
Status = "Ready"

CANVAS = 100.0
HALF = CANVAS / 2.0



def get_curve_points(curve):
    """Preserve exact polyline corners and approximate other curves."""

    # First try to extract original polyline vertices.
    success, polyline = curve.TryGetPolyline()

    if success:
        points = list(polyline)

    else:
        # Approximate smooth curves by sampling points.
        # 256 divisions provide a smooth SVG outline.
        parameters = curve.DivideByCount(256, True)

        if parameters is None:
            raise ValueError("Could not sample curve.")

        points = [
            curve.PointAt(t)
            for t in parameters
        ]

    # Remove duplicate closing point for closed curves.
    if curve.IsClosed and len(points) > 1:
        if points[0].DistanceTo(points[-1]) < 1e-8:
            points.pop()

    return points



def curve_to_path(curve):
    """Convert a Rhino curve to an SVG path without scaling."""

    points = get_curve_points(curve)

    if len(points) < 2:
        raise ValueError("Curve has insufficient points.")

    commands = []

    for i, pt in enumerate(points):
        x = pt.X + HALF
        y = HALF - pt.Y

        command = "M" if i == 0 else "L"

        commands.append(
            "{} {:.4f} {:.4f}".format(command, x, y)
        )

    if curve.IsClosed:
        commands.append("Z")

    return " ".join(commands)


def export_svg(curves):

    if isinstance(curves, rg.Curve):
        curves = [curves]
    else:
        curves = list(curves) if curves is not None else []

    curves = [c for c in curves if c is not None]

    if not curves:
        raise ValueError("No curves supplied.")

    closed_paths = []
    open_paths = []

    for curve in curves:

        path_data = curve_to_path(curve)

        if curve.IsClosed:
            closed_paths.append(path_data)
        else:
            open_paths.append(path_data)

    elements = []

    # Combine closed curves into one compound path.
    # Nested boundaries create holes using evenodd.
    if closed_paths:

        elements.append(
            '  <path d="{}" '
            'fill="param(fill) #B7DFF2" '
            'fill-rule="evenodd" '
            'stroke="param(outline) #334155" '
            'stroke-width="param(outline-width) 0.5" '
            'stroke-linejoin="miter" />'.format(
                " ".join(closed_paths)
            )
        )

    # Open curves have no fill.
    for path_data in open_paths:

        elements.append(
            '  <path d="{}" '
            'fill="none" '
            'stroke="param(outline) #334155" '
            'stroke-width="param(outline-width) 0.5" '
            'stroke-linecap="round" '
            'stroke-linejoin="round" />'.format(
                path_data
            )
        )

    svg = """<?xml version="1.0" encoding="UTF-8"?>
<svg xmlns="http://www.w3.org/2000/svg"
     version="1.1"
     width="100"
     height="100"
     viewBox="0 0 100 100">
{}
</svg>
""".format("\n".join(elements))

    return svg, len(closed_paths), len(open_paths)


try:

    SVG, closed_count, open_count = export_svg(C)

    if Run:

        if not Path or not str(Path).strip():
            raise ValueError("Please provide an SVG output path.")

        output_path = os.path.abspath(str(Path).strip())

        if not output_path.lower().endswith(".svg"):
            output_path += ".svg"

        folder = os.path.dirname(output_path)

        if folder and not os.path.isdir(folder):
            os.makedirs(folder)

        with open(output_path, "w", encoding="utf-8") as file:
            file.write(SVG)

        Status = (
            "SVG exported successfully.\n"
            "Closed curves: {}\n"
            "Open curves: {}\n"
            "Canvas: 100 x 100 (no scaling)\n"
            "File: {}".format(
                closed_count, open_count, output_path
            )
        )

    else:

        Status = (
            "Ready to export.\n"
            "Closed curves: {}\n"
            "Open curves: {}\n"
            "Canvas: 100 x 100".format(
                closed_count, open_count
            )
        )

except Exception as error:

    Status = "Error: {}".format(str(error))
# ---------- end py3 ----------
panel_2 = Panel(py3.out)
panel_3 = Panel(py3.Status)
