# Grasshopper definition Landscape.gh (Grasshopper 1.0.8)
# plug-ins: Human, Heron

# ---- group: Boundary Curve
# DO BACKGROUND IMAGE
geo = Geometry(<curve referenced from the Rhino model>)  # disabled

# ---- group: USGS Raster Maps
usgs = ValueList({"Ortho 1 Foot Imagery": "http://raster.nationalmap.gov/arcgis/rest/services/Orthoimagery/USGS_EROS_Ortho_1Foot/ImageServer/exportImage?", "Ortho Imagery": "http://raster.nationalmap.gov/arcgis/rest/services/Orthoimagery/USGS_EROS_Ortho/ImageServer/exportImage?", "NAIP Imagery": "http://raster.nationalmap.gov/arcgis/rest/services/Orthoimagery/USGS_EROS_Ortho_NAIP/ImageServer/exportImage?", "Land Cover": "http://raster.nationalmap.gov/arcgis/rest/services/LandCover/USGS_EROS_LandCover_NLCD/MapServer/export?", "Land Cover - Conus 01": "http://raster.nationalmap.gov/arcgis/rest/services/LandCover/conus_01/MapServer/export?", "Land Cover - Conus 06": "http://raster.nationalmap.gov/arcgis/rest/services/LandCover/conus_06/MapServer/export?", "Land Cover - Development": "http://raster.nationalmap.gov/arcgis/rest/services/LandCover/Development_0106/MapServer/export?", "Land Cover - Wetland": "http://raster.nationalmap.gov/arcgis/rest/services/LandCover/Wetland_0106/MapServer/export?", "Topo - Scanned Maps": "http://raster.nationalmap.gov/arcgis/rest/services/Scanned_Maps/USGS_EROS_DRG_SCALE/ImageServer/exportImage?"}, selected="Ortho 1 Foot Imagery")  # disabled

# ---- group: Not all imagery available at each resolution
resolution = ValueList({"None": , "Low": 256, "Med": 512, "High": 1024, "Max": 2048}, selected="Max")  # disabled

# ----
path = FilePath("C:\Users\VincentNowak\Dropbox\UCL RC15 Skills 2025\PervasiveUrbanism_25-26\Extra 01 - OGis to Rhino\Points.csv")

# ---- group: Catalog of ESRI ArcGIS REST Basemaps
esri_arcgis_base_maps = ValueList({"World Imagery": "http://server.arcgisonline.com/ArcGIS/rest/services/World_Imagery/MapServer/export?", "World Topographic": "http://server.arcgisonline.com/ArcGIS/rest/services/World_Topo_Map/MapServer/export?", "World Physical Map": "http://server.arcgisonline.com/ArcGIS/rest/services/World_Physical_Map/MapServer/export?", "World Street Map": "http://server.arcgisonline.com/ArcGIS/rest/services/World_Street_Map/MapServer/export?", "World DeLorme Street Map": "http://server.arcgisonline.com/ArcGIS/rest/services/Specialty/DeLorme_World_Base_Map/MapServer/export?", "World Shaded Relief": "http://server.arcgisonline.com/ArcGIS/rest/services/World_Shaded_Relief/MapServer/export?", "World Terrain Base": "http://server.arcgisonline.com/ArcGIS/rest/services/World_Terrain_Base/MapServer/export?", "World Boundaries and Places": "http://server.arcgisonline.com/ArcGIS/rest/services/Reference/World_Boundaries_and_Places/MapServer/export?", "World Boundaries and Places Alt": "http://server.arcgisonline.com/ArcGIS/rest/services/Reference/World_Boundaries_and_Places_Alternate/MapServer/export?", "World Reference Overlay": "http://server.arcgisonline.com/ArcGIS/rest/services/Reference/World_Reference_Overlay/MapServer/export?", "World Transportation": "http://server.arcgisonline.com/ArcGIS/rest/services/Reference/World_Transportation/MapServer/export?", "World Light Gray Base": "http://server.arcgisonline.com/ArcGIS/rest/services/Canvas/World_Light_Gray_Base/MapServer/export?", "World Light Gray Reference": "http://server.arcgisonline.com/ArcGIS/rest/services/Canvas/World_Light_Gray_Reference/MapServer/export?", "National Geographic World": "http://services.arcgisonline.com/ArcGIS/rest/services/NatGeo_World_Map/MapServer/export?", "USA Topo Maps": "http://server.arcgisonline.com/ArcGIS/rest/services/USA_Topo_Maps/MapServer/export?"}, selected="World Imagery")  # disabled

# ----
file = ReadFile(File=path, PerLineParse=True)
seteap = SetEarthAnchorPoint(SetEAP=Toggle(True), Latitude="45.432428034278786 ", Longitude="12.354864748265944")
button = Button()  # disabled

folder_location_for_images = Panel("C:\Users\VincentNowak\Dropbox\UCL RC15 Skills 2025\PervasiveUrbanism_25-26\Extra 01 - OGis to Rhino")  # disabled
image_prefix = Panel("aerial")  # disabled
restraster = GetRESTRaster(
    Boundary=geo,
    Resolution=resolution,
    TargetFolder=folder_location_for_images,
    Prefix=image_prefix,
    RESTURL=esri_arcgis_base_maps,
    ImageType="jpg",
    Run=button)  # -> Image, ImageFrame, RESTQuery; disabled
panel = Panel(esri_arcgis_base_maps)  # disabled

cull_i = CullIndex(List=file, Indices="0", Wrap=True)  # -> graft(List)
panel_2 = Panel(file)
split = TextSplit(Text=cull_i, Separators=",")
item = ListItem(List=split, Index="0", Wrap=True)  # -> Item, Item1
item_2 = ListItem(List=split, Index="11", Wrap=True)  # -> Item, Item1
panel_3 = Panel(restraster.Image)  # disabled

# ----
# CONVERT COORDINATES TO XY VALUES
flatten = FlattenTree(Tree=item.Item1, Path="{0}")
flatten_2 = FlattenTree(Tree=item.Item, Path="{0}")
ddtoxy = DecimalDegreesToXY(Latitude=flatten, Longitude=flatten_2)  # -> XyPoint, Transform
geo_2 = Geometry(ddtoxy.XyPoint)
panel_4 = Panel(ddtoxy.XyPoint)

multiplication = Multiplication(A=item_2.Item, B=Slider(0.2, range=0..1))
pdecon = Deconstruct(Point=geo_2)  # -> XComponent, YComponent, ZComponent
pt = ConstructPoint(XCoordinate=pdecon.XComponent, YCoordinate=pdecon.YComponent, ZCoordinate=flatten(multiplication))
srfgrid = SurfaceFromPoints(Points=pt, UCount="10", Interpolate=False)
path_2 = FilePath("C:\Users\VincentNowak\Dropbox\UCL RC15 Skills 2025\PervasiveUrbanism_25-26\Extra 01 - OGis to Rhino\Photos.csv")
file_2 = ReadFile(File=path_2, PerLineParse=True)

# ---- group: Graphics & Baking
contour = Contour(Shape=srfgrid, Point=Point(0, 0, 0), Direction=Vector(0, 0, 1), Distance=Slider(1, range=0..1))
eval = EvaluateCurve(Curve=reparameterize(contour), Parameter=0)  # -> Point, Tangent, Angle
pdecon_2 = Deconstruct(Point=eval.Point)  # -> XComponent, YComponent, ZComponent
bnd = Bounds(Numbers=flatten(pdecon_2.ZComponent))
dedomain = DeconstructDomain(Domain=bnd)  # -> Start, End
gradient = Gradient(
    LowerLimit=dedomain.Start,
    UpperLimit=dedomain.End,
    Parameter=flatten(pdecon_2.ZComponent),
    stops=[0: RGB(234, 38, 0), 0.25: RGB(234, 126, 0), 0.5: RGB(254, 244, 84), 0.75: RGB(173, 203, 249), 1: RGB(75, 107, 169)])
preview = CustomPreview(Geometry=flatten(contour), Material=gradient)
createatts = CreateAttributes(LayerName="Contours", Color=gradient, enableFullPath=False)
bake = BakeGeometry(Bake=Button(), Geometry=flatten(contour), Attributes=createatts, DeleteOldBakes=False, PreserveTrees=False)

# ----
cull_i_2 = CullIndex(List=file_2, Indices="0", Wrap=True)  # -> graft(List)
panel_5 = Panel(file_2)
split_2 = TextSplit(Text=cull_i_2, Separators=",")
item_3 = ListItem(List=split_2, Index="0", Wrap=True)  # -> Item, Item1
panel_6 = Panel(item_3.Item)

# ----
# CONVERT COORDINATES TO XY VALUES
flatten_3 = FlattenTree(Tree=item_3.Item1, Path="{0}")
flatten_4 = FlattenTree(Tree=item_3.Item, Path="{0}")
ddtoxy_2 = DecimalDegreesToXY(Latitude=flatten_3, Longitude=flatten_4)  # -> XyPoint, Transform
geo_3 = Geometry(ddtoxy_2.XyPoint)
panel_7 = Panel(ddtoxy_2.XyPoint)
