# Grasshopper definition Heron.gh (Grasshopper 1.0.8)
# plug-ins: MeshEdit Components, Human, Heron

rec = Rectangle({Plane=PlaneXY(4477.079476, -2414.543876, 0), Size=Domain2(u=-4477.079476..4477.079476, v=-2414.543876..2414.543876)})  # disabled
max_lat_north = Panel("51.5014800000000008")
min_lat_south = Panel("51.5449500000000000")
max_lon_east = Panel("0.0601670000000000")
min_lon_west = Panel("-0.0694400000000000")

# ---- group: Boundary Curve
# DO BACKGROUND IMAGE
geo = Geometry(rec)  # disabled

# ---- group: USGS Raster Maps
usgs = ValueList({"Ortho 1 Foot Imagery": "http://raster.nationalmap.gov/arcgis/rest/services/Orthoimagery/USGS_EROS_Ortho_1Foot/ImageServer/exportImage?", "Ortho Imagery": "http://raster.nationalmap.gov/arcgis/rest/services/Orthoimagery/USGS_EROS_Ortho/ImageServer/exportImage?", "NAIP Imagery": "http://raster.nationalmap.gov/arcgis/rest/services/Orthoimagery/USGS_EROS_Ortho_NAIP/ImageServer/exportImage?", "Land Cover": "http://raster.nationalmap.gov/arcgis/rest/services/LandCover/USGS_EROS_LandCover_NLCD/MapServer/export?", "Land Cover - Conus 01": "http://raster.nationalmap.gov/arcgis/rest/services/LandCover/conus_01/MapServer/export?", "Land Cover - Conus 06": "http://raster.nationalmap.gov/arcgis/rest/services/LandCover/conus_06/MapServer/export?", "Land Cover - Development": "http://raster.nationalmap.gov/arcgis/rest/services/LandCover/Development_0106/MapServer/export?", "Land Cover - Wetland": "http://raster.nationalmap.gov/arcgis/rest/services/LandCover/Wetland_0106/MapServer/export?", "Topo - Scanned Maps": "http://raster.nationalmap.gov/arcgis/rest/services/Scanned_Maps/USGS_EROS_DRG_SCALE/ImageServer/exportImage?"}, selected="Ortho 1 Foot Imagery")  # disabled

# ---- group: Not all imagery available at each resolution
resolution = ValueList({"None": , "Low": 256, "Med": 512, "High": 1024, "Max": 2048}, selected="Max")  # disabled

# ----
geo_2 = Geometry([<curve referenced from the Rhino model> x2])

# ---- group: Catalog of ESRI ArcGIS REST Basemaps
esri_arcgis_base_maps = ValueList({"World Imagery": "http://server.arcgisonline.com/ArcGIS/rest/services/World_Imagery/MapServer/export?", "World Topographic": "http://server.arcgisonline.com/ArcGIS/rest/services/World_Topo_Map/MapServer/export?", "World Physical Map": "http://server.arcgisonline.com/ArcGIS/rest/services/World_Physical_Map/MapServer/export?", "World Street Map": "http://server.arcgisonline.com/ArcGIS/rest/services/World_Street_Map/MapServer/export?", "World DeLorme Street Map": "http://server.arcgisonline.com/ArcGIS/rest/services/Specialty/DeLorme_World_Base_Map/MapServer/export?", "World Shaded Relief": "http://server.arcgisonline.com/ArcGIS/rest/services/World_Shaded_Relief/MapServer/export?", "World Terrain Base": "http://server.arcgisonline.com/ArcGIS/rest/services/World_Terrain_Base/MapServer/export?", "World Boundaries and Places": "http://server.arcgisonline.com/ArcGIS/rest/services/Reference/World_Boundaries_and_Places/MapServer/export?", "World Boundaries and Places Alt": "http://server.arcgisonline.com/ArcGIS/rest/services/Reference/World_Boundaries_and_Places_Alternate/MapServer/export?", "World Reference Overlay": "http://server.arcgisonline.com/ArcGIS/rest/services/Reference/World_Reference_Overlay/MapServer/export?", "World Transportation": "http://server.arcgisonline.com/ArcGIS/rest/services/Reference/World_Transportation/MapServer/export?", "World Light Gray Base": "http://server.arcgisonline.com/ArcGIS/rest/services/Canvas/World_Light_Gray_Base/MapServer/export?", "World Light Gray Reference": "http://server.arcgisonline.com/ArcGIS/rest/services/Canvas/World_Light_Gray_Reference/MapServer/export?", "National Geographic World": "http://services.arcgisonline.com/ArcGIS/rest/services/NatGeo_World_Map/MapServer/export?", "USA Topo Maps": "http://server.arcgisonline.com/ArcGIS/rest/services/USA_Topo_Maps/MapServer/export?"}, selected="World Imagery")  # disabled

# ----
Z = UnitZ(Factor=Slider(3000, range=0..10000))
extr = Extrude(Base=geo_2, Direction=Z)
seteap = SetEarthAnchorPoint(SetEAP=Button(), Latitude=min_lat_south, Longitude=min_lon_west)
button = Button()  # disabled

image_prefix = Panel("aerial")  # disabled
folder_location_for_images = Panel("C:\Users\vince\Dropbox\Sentiment Landscapes\Rhino\assets")  # disabled
toggle = BooleanToggle(True)  # disabled
restraster = GetRESTRaster(
    Boundary=geo,
    Resolution=resolution,
    TargetFolder=folder_location_for_images,
    Prefix=image_prefix,
    RESTURL=esri_arcgis_base_maps,
    ImageType="jpg",
    Run=button)  # -> Image, ImageFrame, RESTQuery; disabled
panel = Panel(esri_arcgis_base_maps)  # disabled

ddtoxy = DecimalDegreesToXY(Latitude=max_lat_north, Longitude=max_lon_east)  # -> XyPoint, Transform
ddtoxy_2 = DecimalDegreesToXY(Latitude=max_lat_north, Longitude=min_lon_west)  # -> XyPoint, Transform
ddtoxy_3 = DecimalDegreesToXY(Latitude=min_lat_south, Longitude=min_lon_west)  # -> XyPoint, Transform
ddtoxy_4 = DecimalDegreesToXY(Latitude=min_lat_south, Longitude=max_lon_east)  # -> XyPoint, Transform
pl_3pt = Plane3Pt(
    PointA=<geometry referenced from the Rhino model>,
    PointB=<geometry referenced from the Rhino model>,
    PointC=<geometry referenced from the Rhino model>)
panel_2 = Panel(seteap)
recgrid = Rectangular(Plane=PlaneXY(0, 0, 0), SizeX=1, SizeY=2, ExtentX=10, ExtentY=5)  # -> Cells, Points
ddtoxy_5 = DecimalDegreesToXY()  # -> XyPoint, Transform
sqgrid = Square(Plane=pl_3pt, Size=1, ExtentX=5, ExtentY=5)  # -> Cells, Points
rec_3pt = Rectangle3Pt(PointA=ddtoxy.XyPoint, PointB=ddtoxy_2.XyPoint, PointC=ddtoxy_3.XyPoint)  # -> Rectangle, Length
path = FilePath("C:\Users\vince\Dropbox\Sentiment Landscapes\Rhino\assets\map.osm")  # disabled
panel_3 = Panel("large")  # disabled
filterfiields = Panel("natural")
filterfieldvalue = Panel("natural,tree")
panel_4 = Panel("addr:postcode,SE1 7ND")
panel_5 = Panel("amenity,cafe")
button_2 = Button()  # disabled
rec_2 = Rectangle({Plane=PlaneXY(4477.079476, -2414.543876, 0), Size=Domain2(u=-4477.079476..4477.079476, v=-2414.543876..2414.543876)})
rec_3 = Rectangle({Plane=PlaneXY(4477.079476, -2414.543876, 0), Size=Domain2(u=-4477.079476..4477.079476, v=-2414.543876..2414.543876)})  # disabled
toggle_2 = BooleanToggle(True)  # disabled
panel_6 = Panel(path)  # disabled
path_2 = FilePath("C:\Users\vince\Dropbox\Sentiment Landscapes\Rhino\assets\large.osm")
panel_7 = Panel("C:\Users\vince\Dropbox\Sentiment Landscapes\Rhino\assets")  # disabled
osmrest = GetRESTOSM(Boundary=rec_3, FolderPath=panel_7, Prefix=panel_3, Run=button_2, OSMService="Overpass API", Timeout=60)  # -> OSMFile, OSMQuery; disabled
importosm = ImportOSM(Boundary=rec_2, OSMDataLocation=path_2, FilterFields="building", Clipped=True)  # -> Extents, Fields, Values, FeatureGeometry, Buildings; disabled
panel_8 = Panel(importosm.FeatureGeometry)
path_3 = FilePath("G:\My Drive\Sentiment Landscapes\Qgis\CentrHeron3.csv")
file = ReadFile(File=path_3, PerLineParse=True)
cull_i = CullIndex(List=file, Indices="0", Wrap=True)  # -> simplify(graft(List))
split = TextSplit(Text=cull_i, Separators=",")
item = ListItem(List=split, Index="0", Wrap=True)  # -> Item, Item1
panel_9 = Panel(file)
item_2 = ListItem(List=split, Index="10", Wrap=True)  # -> simplify(Item), Item1
panel_10 = Panel(split)
panel_11 = Panel(item_2.Item)
ddtoxy_6 = DecimalDegreesToXY(Latitude=item.Item1, Longitude=item.Item)  # -> XyPoint, Transform
move = Move(Motion=Vector(0, 0, 10))  # -> Geometry, Transform
split_2 = TextSplit(Text="-0.06854168471588,51.5443913338738", Separators=",")
trim = TextTrim(Text=item_2.Item, Start=True, End=True)
min_lat_south_2 = Panel("51.5449500000000000")
min_lon_west_2 = Panel("-0.0694400000000000")
panel_12 = Panel(trim)
item_3 = ListItem(List=split_2, Index=0, Wrap=True)  # -> Item, Item1
ct = CoordinateTransformation(SourceSRS="WGS84", DestinationSRS="WGS84")
txt = Text(trim)
panel_13 = Panel(ddtoxy_6.XyPoint)
num = Number(item_3.Item)
num_2 = Number(item_3.Item1)
rep = ReplaceText(RecursiveReplace=False)
nullrep = ReplaceNulls(Items=txt, Replacements="0")  # -> Items, Count
ddtoxy_7 = DecimalDegreesToXY(Latitude=min_lat_south_2, Longitude=min_lon_west_2)  # -> XyPoint, Transform
ddtoxy_8 = DecimalDegreesToXY(Latitude=num_2, Longitude=num)  # -> XyPoint, Transform
py3 = Python3Script(x=nullrep.Items)  # -> out, a; inputs x: list
# ---------- py3: Python ----------
def safe_float(s):
    try:
        return float(s)
    except:
        return 0.0  # or None, depending on what you want

a = [safe_float(i) for i in x]
# ---------- end py3 ----------
panel_14 = Panel(ddtoxy_7.XyPoint)
panel_15 = Panel(ddtoxy_8.XyPoint)
num_3 = Number(py3.a)
number_slider = Slider(39, range=0..100)
dom = ConstructDomain(DomainStart="50", DomainEnd="6000")
bnd = Bounds(Numbers=flatten(num_3))
remap = RemapNumbers(Value=num_3, Source=bnd, Target=dom)  # -> Mapped, Clipped
Z_2 = UnitZ(Factor=remap.Mapped)
move_2 = Move(Geometry=ddtoxy_6.XyPoint, Motion=Z_2)  # -> Geometry, Transform
srfgrid = SurfaceFromPoints(Points=flatten(move_2.Geometry), UCount="73", Interpolate=Toggle(False))
frompoints = MeshFromPoints(Points=flatten(move_2.Geometry), UDirection="73", VDirection="39")
toggle_3 = BooleanToggle(False)
subdmesh = SubDFromMesh(Mesh=frompoints, Creases="2", Corners="2", Interpolate=False)
preview = CustomPreview(Geometry=subdmesh, Material=ColourSwatch(SwatchColor=RGB(255, 255, 255)))
Z_3 = UnitZ(Factor=1)
xy = XYPlane(Origin=Point(0, 0, 0))
contour = Contour(Shape=subdmesh, Point=xy, Direction=Z_3, Distance=Slider(30, range=0..100))
eval = EvaluateCurve(Curve=reparameterize(contour), Parameter="0")  # -> flatten(Point), Tangent, Angle
pdecon = Deconstruct(Point=eval.Point)  # -> XComponent, YComponent, ZComponent
bnd_2 = Bounds(Numbers=pdecon.ZComponent)
dedomain = DeconstructDomain(Domain=bnd_2)  # -> Start, End
gradient = Gradient(
    LowerLimit=dedomain.Start,
    UpperLimit=dedomain.End,
    Parameter=pdecon.ZComponent,
    stops=[0: RGB(0, 128, 0), 0.5: RGB(255, 255, 0), 1: RGB(255, 0, 0)])
createatts = CreateAttributes(LayerName="Contour", Color=gradient, enableFullPath=False)
preview_2 = CustomPreview(Geometry=flatten(contour), Material=gradient)
bake = BakeGeometry(Bake=Button(), Geometry=flatten(contour), Attributes=createatts, DeleteOldBakes=False, PreserveTrees=False)
