# Grasshopper definition NoiseFieldSim2.gh (Grasshopper 1.0.8)
# plug-ins: Noise

geo = Geometry(<curve referenced from the Rhino model>)
number_slider = Slider(27, range=0..100)
boundary = BoundarySurfaces(Edges=reparameterize(geo))
sdivide = DivideSurface(Surface=boundary, UCount=number_slider, VCount=Slider(26, range=0..100))  # -> Points, Normals, Parameters
panel = Panel("1")
panel_2 = Panel("6")
panel_3 = Panel("10")
geo_2 = Geometry([<point referenced from the Rhino model> x4])
number_slider_2 = Slider(2, range=0..10)
number_slider_3 = Slider(7, range=0..10)
pn = PerlinNoise(
    Points=flatten(sdivide.Points),
    Seed=0,
    Amplitude=1,
    SmoothStep=0,
    FrequecyX=number_slider_2,
    FrequecyY=number_slider_2,
    FrequecyZ=Slider(4, range=0..10),
    Jitter=0,
    AlignVector=Vector(1, 0, 0))
pn_2 = PerlinNoise(
    Points=flatten(sdivide.Points),
    Seed=0,
    Amplitude=1,
    SmoothStep=0,
    FrequecyX=number_slider_3,
    FrequecyY=number_slider_3,
    FrequecyZ=Slider(4, range=0..10),
    Jitter=0,
    AlignVector=Vector(1, 0, 0))
wn = WorleyNoise(Points=flatten(sdivide.Points), Centers=geo_2, DistanceMetric=0, Seed=0)  # -> F1, F2, F3, F4
graph = GraphMapper(
    pn,
    x0=0,
    x1=1,
    y0=0,
    y1=1,
    container_name="Bezier",
    cpx=[0, 0.458522439, 0.4353249371, 1],
    cpy=[0, 0, 0.3796070218, 0.388178587])
py3 = Python3Script(rawNumbers=wn.F1)  # -> out, mappedNumbers; inputs rawNumbers: list of Double
# ---------- py3: Python ----------
"""Grasshopper Script"""
a = "Hello Python 3 in Grasshopper!"
maxNumber = max(rawNumbers)
mappedNumbers = []

for rawNumber in rawNumbers:
    mappedVal = rawNumber/maxNumber
    mappedNumbers.append(mappedVal)
# ---------- end py3 ----------
graph_2 = GraphMapper(
    pn_2,
    x0=0,
    x1=1,
    y0=0,
    y1=1,
    container_name="Bezier",
    cpx=[0, 0.3376438022, 0.5278038383, 1],
    cpy=[0, 0, 0.5289511681, 0.5188667774])
graph_3 = GraphMapper(py3.mappedNumbers, x0=0, x1=1, y0=0, y1=1, container_name="Bezier", cpx=[0, 0, 0.3220922351, 1], cpy=[1, 0, 0, 0])
multiplication = Multiplication(A=graph_3, B=Slider(3.6, range=-2..4))
addition = Addition(A=graph_2, B=graph, C=multiplication)
addition_2 = Addition(A=number_slider, B="1")
multiplication_2 = Multiplication(A=addition, B="1000")
Z = UnitZ(Factor=multiplication_2)
Z_2 = UnitZ(Factor=1)
move = Move(Geometry=flatten(sdivide.Points), Motion=Z)  # -> Geometry, Transform
srfgrid = SurfaceFromPoints(Points=move.Geometry, UCount=addition_2, Interpolate=False)
xy = XYPlane(Origin=Point(0, 0, 0))
preview = CustomPreview(Geometry=srfgrid, Material=ColourSwatch(SwatchColor=RGB(207, 204, 204)))
contour = Contour(Shape=srfgrid, Point=xy, Direction=Z_2, Distance=Slider(30, range=0..100))
eval = EvaluateCurve(Curve=reparameterize(contour), Parameter="0")  # -> flatten(Point), Tangent, Angle
pdecon = Deconstruct(Point=eval.Point)  # -> XComponent, YComponent, ZComponent
bnd = Bounds(Numbers=pdecon.ZComponent)
dedomain = DeconstructDomain(Domain=bnd)  # -> Start, End
gradient = Gradient(
    LowerLimit=dedomain.Start,
    UpperLimit=dedomain.End,
    Parameter=pdecon.ZComponent,
    stops=[0: RGB(0, 128, 0), 0.5: RGB(255, 255, 0), 1: RGB(255, 0, 0)])
preview_2 = CustomPreview(Geometry=flatten(contour), Material=gradient)
