# Grasshopper definition unnamed.gh (Grasshopper 1.0.8)
# plug-ins: Heron

x_maximum_longitude_eastern_boundary = Panel("0.0145")
x_minimum_longitude_western_boundary = Panel("-0.014597")
y_maximum_latitude_northern_boundary = Panel("51.529249")
y_minimum_latitude_southern_boundary = Panel("51.50313")

# ---- group: Boundary Curve
geo = Geometry(<curve referenced from the Rhino model>)

# ---- group: USGS Raster Maps
usgs = ValueList({"Ortho 1 Foot Imagery": "http://raster.nationalmap.gov/arcgis/rest/services/Orthoimagery/USGS_EROS_Ortho_1Foot/ImageServer/exportImage?", "Ortho Imagery": "http://raster.nationalmap.gov/arcgis/rest/services/Orthoimagery/USGS_EROS_Ortho/ImageServer/exportImage?", "NAIP Imagery": "http://raster.nationalmap.gov/arcgis/rest/services/Orthoimagery/USGS_EROS_Ortho_NAIP/ImageServer/exportImage?", "Land Cover": "http://raster.nationalmap.gov/arcgis/rest/services/LandCover/USGS_EROS_LandCover_NLCD/MapServer/export?", "Land Cover - Conus 01": "http://raster.nationalmap.gov/arcgis/rest/services/LandCover/conus_01/MapServer/export?", "Land Cover - Conus 06": "http://raster.nationalmap.gov/arcgis/rest/services/LandCover/conus_06/MapServer/export?", "Land Cover - Development": "http://raster.nationalmap.gov/arcgis/rest/services/LandCover/Development_0106/MapServer/export?", "Land Cover - Wetland": "http://raster.nationalmap.gov/arcgis/rest/services/LandCover/Wetland_0106/MapServer/export?", "Topo - Scanned Maps": "http://raster.nationalmap.gov/arcgis/rest/services/Scanned_Maps/USGS_EROS_DRG_SCALE/ImageServer/exportImage?"}, selected="Ortho 1 Foot Imagery")

# ---- group: Not all imagery available at each resolution
resolution = ValueList({"None": , "Low": 256, "Med": 512, "High": 1024, "Max": 2048}, selected="Max")

# ---- group: Catalog of ESRI ArcGIS REST Basemaps
esri_arcgis_base_maps = ValueList({"World Imagery": "http://server.arcgisonline.com/ArcGIS/rest/services/World_Imagery/MapServer/export?", "World Topographic": "http://server.arcgisonline.com/ArcGIS/rest/services/World_Topo_Map/MapServer/export?", "World Physical Map": "http://server.arcgisonline.com/ArcGIS/rest/services/World_Physical_Map/MapServer/export?", "World Street Map": "http://server.arcgisonline.com/ArcGIS/rest/services/World_Street_Map/MapServer/export?", "World DeLorme Street Map": "http://server.arcgisonline.com/ArcGIS/rest/services/Specialty/DeLorme_World_Base_Map/MapServer/export?", "World Shaded Relief": "http://server.arcgisonline.com/ArcGIS/rest/services/World_Shaded_Relief/MapServer/export?", "World Terrain Base": "http://server.arcgisonline.com/ArcGIS/rest/services/World_Terrain_Base/MapServer/export?", "World Boundaries and Places": "http://server.arcgisonline.com/ArcGIS/rest/services/Reference/World_Boundaries_and_Places/MapServer/export?", "World Boundaries and Places Alt": "http://server.arcgisonline.com/ArcGIS/rest/services/Reference/World_Boundaries_and_Places_Alternate/MapServer/export?", "World Reference Overlay": "http://server.arcgisonline.com/ArcGIS/rest/services/Reference/World_Reference_Overlay/MapServer/export?", "World Transportation": "http://server.arcgisonline.com/ArcGIS/rest/services/Reference/World_Transportation/MapServer/export?", "World Light Gray Base": "http://server.arcgisonline.com/ArcGIS/rest/services/Canvas/World_Light_Gray_Base/MapServer/export?", "World Light Gray Reference": "http://server.arcgisonline.com/ArcGIS/rest/services/Canvas/World_Light_Gray_Reference/MapServer/export?", "National Geographic World": "http://services.arcgisonline.com/ArcGIS/rest/services/NatGeo_World_Map/MapServer/export?", "USA Topo Maps": "http://server.arcgisonline.com/ArcGIS/rest/services/USA_Topo_Maps/MapServer/export?"}, selected="World Light Gray Base")

# ----
ddtoxy = DecimalDegreesToXY(Latitude=y_maximum_latitude_northern_boundary, Longitude=x_minimum_longitude_western_boundary)  # -> XyPoint, Transform
ddtoxy_2 = DecimalDegreesToXY(Latitude=y_minimum_latitude_southern_boundary, Longitude=x_minimum_longitude_western_boundary)  # -> XyPoint, Transform
pt = ConstructPoint(XCoordinate=x_minimum_longitude_western_boundary, YCoordinate=y_minimum_latitude_southern_boundary, ZCoordinate=0)
ddtoxy_3 = DecimalDegreesToXY(Latitude=y_maximum_latitude_northern_boundary, Longitude=x_maximum_longitude_eastern_boundary)  # -> XyPoint, Transform
ddtoxy_4 = DecimalDegreesToXY()  # -> XyPoint, Transform
rec_3pt = Rectangle3Pt(PointA=ddtoxy.XyPoint, PointB=ddtoxy_2.XyPoint, PointC=ddtoxy_3.XyPoint)  # -> Rectangle, Length
rec_3pt_2 = Rectangle3Pt(PointA=ddtoxy.XyPoint, PointB=ddtoxy_2.XyPoint, PointC=ddtoxy_3.XyPoint)  # -> Rectangle, Length

image_prefix = Panel("aerial")
folder_location_for_images = Panel("G:\My Drive\Sentiment Landscapes\assets")
restraster = GetRESTRaster(
    Boundary=rec_3pt_2.Rectangle,
    Resolution=resolution,
    TargetFolder=folder_location_for_images,
    Prefix=image_prefix,
    RESTURL=esri_arcgis_base_maps,
    ImageType="jpg",
    Run=Button())  # -> Image, ImageFrame, RESTQuery
panel = Panel(esri_arcgis_base_maps)

path = FilePath("G:\My Drive\Sentiment Landscapes\assets\")
rec = Rectangle()
seteap = SetEarthAnchorPoint(SetEAP=Button(), Latitude=pt)
rec_3pt_3 = Rectangle3Pt(PointA=ddtoxy.XyPoint, PointB=ddtoxy_2.XyPoint, PointC=ddtoxy_3.XyPoint)  # -> Rectangle, Length
osmrest = GetRESTOSM(Boundary=rec_3pt.Rectangle, FolderPath=path, Prefix="EastLondon", Run=Button(), OSMService="Overpass API", Timeout=60)  # -> OSMFile, OSMQuery
panel_2 = Panel("""building
natural""")
panel_3 = Panel("natural,water")
panel_4 = Panel("building,house")
path_2 = FilePath("G:\My Drive\Sentiment Landscapes\assets\EastLondon.osm")
importosm = ImportOSM(Boundary=rec_3pt_3.Rectangle, OSMDataLocation=path_2, FilterFields="building", Clipped=True)  # -> Extents, Fields, Values, FeatureGeometry, Buildings
