# Grasshopper definition Surface Division.gh (Grasshopper 1.0.8)
# plug-ins: VVVVLink, LunchBox

geo = Geometry(<surface referenced from the Rhino model>)
hex = HexagonCells(Surface=geo, UDivisions=Slider(9, range=0..50), VDivisions=Slider(5, range=0..50), TParameter=0.25)  # -> simplify(graft(HexagonCells)), graft(Centers)
srf_cp = SurfaceClosestPoint(Point=hex.Centers, Surface=geo)  # -> Point, UVPoint, Distance
evalsrf = EvaluateSurface(Surface=geo, Point=srf_cp.UVPoint)  # -> Point, Normal, UDirection, VDirection, Frame
scale = Scale(Geometry=hex.HexagonCells, Center=hex.Centers, Factor=Slider(0.2, range=0..2))  # -> Geometry, Transform
multiplication = Multiplication(A=evalsrf.Normal, B=Slider(2.9, range=0..3))
move = Move(Geometry=scale.Geometry, Motion=multiplication)  # -> simplify(Geometry), Transform
loft = Loft(
    Curves=[hex.HexagonCells, move.Geometry],
    Options={Adjust=False, Closed=False, LoftEnds=0, LoftSimp=0, LoftType=0, Rebuild=10, Refit=0.01})
geo_2 = Geometry(flatten(loft))
flatten = FlattenTree(Tree=loft, Path="{0}")
smesh = SimpleMesh(Brep=flatten)
mjoin = MeshJoin(Meshes=smesh)
subdmesh = SubDFromMesh(Mesh=mjoin, Creases=1, Corners=1, Interpolate=False)
smooth = SettingsQuality()
mesh = MeshBrep(Brep=subdmesh, Settings=smooth)
vlinks = VLinkSend(Geometry=mesh, CurveTolerance=0.5, Send=Toggle(True))
