# Grasshopper definition Particles.gh (Grasshopper 1.0.8)
# plug-ins: VVVVLink, Agent

trigger = Trigger(Interval=10, TimerInterval=10, Target=[engine, system])
particle = ConstructParticle(UpDirection=Vector(0, 0, 1), Acceleration=Vector(0, 0, 0), Lifespan="400", Mass=1, BodySize=1, HistoryLength=1)
ptemit = PointEmitter(
    ContinuousFlow=True,
    CreationRate=1,
    NumberOfQuelea="500",
    MinimumInitialVelocity="{-0.01,-0.01,-0.00}",
    MaximumInitialVelocity="{0.02,0.06,0.001}",
    Point=Point(0, 0, 0))
system = System(QueleaSettings=particle, Emitters=ptemit)  # -> System, Quelea, QueleaNetwork
departicle = DeconstructParticle(ParticleQuelea=system.Quelea)  # -> flatten(Position), Velocity, Acceleration, Lifespan, SurfacePosition, SurfaceVelocity, SurfaceAcceleration
engine = Engine(Reset=Toggle(False), System=system.System)
unit = UnitVector(Vector=departicle.Velocity)
vdis = VectorDisplay(Anchor=departicle.Position, Vector=unit)
pdecon = Deconstruct(Point=departicle.Position)  # -> XComponent, YComponent, ZComponent
# VL.Rhino allows text to be sent from Grasshopper to vvvv. This is advantageous when we want to transmit positional data alongside other information, such as direction. The string built here then needs to be decoded on the receiving side.
pdecon_2 = Deconstruct(Point=departicle.Velocity)  # -> XComponent, YComponent, ZComponent
format = Format(
    Format="{0},{1},{2},{3},{4},{5}",
    Culture=127,
    Data0=pdecon.XComponent,
    Data1=pdecon.YComponent,
    Data2=pdecon.ZComponent,
    Data3=pdecon_2.XComponent,
    Data4=pdecon_2.YComponent,
    Data5=pdecon_2.ZComponent)
panel = Panel(format)
vlinks = VLinkSend(CurveTolerance=0.5, Strings=format, Send=Toggle(True))
